% Simulink data dictionary REL.sldd

DoorRat_Sts_E = enum(DefaultValue="Invalid", StorageType="uint8")
  Invalid = 0
  All_Lock = 1
  Half_Lock = 2
  Unlock = 3

Motor_Cmd_E = enum(DefaultValue="Stop", StorageType="uint8")
  Stop = 0
  Rls = 1
  Reset = 2